# Dynamo graph Basic_Primitive_Nodes.dyn (Dynamo 3.0.3.7597)

# group: 基本体造型
bySphereCenterRadius = AnyCAD.UserNodes.Elements.UserShapeNode.BySphereCenterRadius()
code_block = CodeBlock { 3; 5; -0.5; 8; 12; Math.PI * 2; Math.PI; }
byOrigin = CoordinateSystem.ByOrigin(x=code_block.out0)
byConeAxisRadiusHeight = AnyCAD.UserNodes.Elements.UserShapeNode.ByConeAxisRadiusHeight(cs=byOrigin, height=code_block.out0)
byOrigin_2 = CoordinateSystem.ByOrigin(x=code_block.out1, y=code_block.out2)
byBoxAxisLengths = AnyCAD.UserNodes.Elements.UserShapeNode.ByBoxAxisLengths(cs=byOrigin_2)
byOrigin_3 = CoordinateSystem.ByOrigin(x=code_block.out3)
byCylinderAxisRadiusHeight = AnyCAD.UserNodes.Elements.UserShapeNode.ByCylinderAxisRadiusHeight(cs=byOrigin_3, height=code_block.out1)
byOrigin_4 = CoordinateSystem.ByOrigin(x=code_block.out4)
code_block_2 = CodeBlock { 0.5; 1.5; }
byTorusMajorMinorAngle = AnyCAD.UserNodes.Elements.UserShapeNode.ByTorusMajorMinorAngle(cs=byOrigin_4, majorR=code_block_2.out1, minorR=code_block_2.out0, angle=code_block.out5)

# group: 文档材质获取
code_block_3 = CodeBlock { "Default"; }
byName = AnyCAD.CoreNodes.Elements.MaterialNode.ByName(name=code_block_3)

# group: 物体颜色设置
code_block_4 = CodeBlock { 231; 213; 124; }
nijika_yellow = Color.ByARGB(red=code_block_4.out0, green=code_block_4.out1, blue=code_block_4.out2)
setColor = AnyCAD.CoreNodes.Elements.ShapeElementNode.SetColor(shapeElementNode=byConeAxisRadiusHeight, color=nijika_yellow)
code_block_5 = CodeBlock { 238; 183; 197; }
boochi_pink = Color.ByARGB(red=code_block_5.out0, green=code_block_5.out1, blue=code_block_5.out2)
setColor_2 = AnyCAD.CoreNodes.Elements.ShapeElementNode.SetColor(shapeElementNode=byBoxAxisLengths, color=boochi_pink)
code_block_6 = CodeBlock { 210; 86; 78; }
ikuyo_red = Color.ByARGB(red=code_block_6.out0, green=code_block_6.out1, blue=code_block_6.out2)
setColor_3 = AnyCAD.CoreNodes.Elements.ShapeElementNode.SetColor(shapeElementNode=byCylinderAxisRadiusHeight, color=ikuyo_red)
code_block_7 = CodeBlock { 64; 97; 161; }
ryo_blue = Color.ByARGB(red=code_block_7.out0, green=code_block_7.out1, blue=code_block_7.out2)
setColor_4 = AnyCAD.CoreNodes.Elements.ShapeElementNode.SetColor(shapeElementNode=byTorusMajorMinorAngle, color=ryo_blue)

# group: 生成随机材质属性
now = DateTime.Now()
components = DateTime.Components(dateTime=now)
radomColor = Python(IN[0]=components.second)  # CPython3
# ---------- radomColor.python (28 lines) ----------
# Load the Python Standard and DesignScript Libraries
import sys
import clr
clr.AddReference('ProtoGeometry')
from Autodesk.DesignScript.Geometry import *
clr.AddReference('DSCoreNodes')
import DSCore as DSC

import random

# The inputs to this node will be stored as a list in the IN variables.
dataEnteringNode = IN

# Place your code below this line
def random_color():
    a= random.randint(0, 255)
    r= random.randint(0, 255)
    g= random.randint(0, 255)
    b= random.randint(0, 255)
    
    # random.shuffle(rgbl)
    return DSC.Color.ByARGB(a, r, g, b)

random.seed(IN[0])
color = random_color()

# Assign your output to the OUT variable.
OUT = color
# ----------------------------------------
code_block_8 = CodeBlock(seed=components.millisecond) { seed + 13; seed + 31; }
random = Math.Random(seed=code_block_8.out0)
random_2 = Math.Random(seed=code_block_8.out1)

# group: 材质属性设置
setMaterial = AnyCAD.CoreNodes.Elements.ShapeElementNode.SetMaterial(shapeElementNode=bySphereCenterRadius, material=byName)
setFaceColor = AnyCAD.CoreNodes.Elements.MaterialNode.SetFaceColor(materialNode=byName, color=radomColor)
setMetalness = AnyCAD.CoreNodes.Elements.MaterialNode.SetMetalness(materialNode=byName, metalness=random)
setRoughness = AnyCAD.CoreNodes.Elements.MaterialNode.SetRoughness(materialNode=byName, roughness=random_2)

number_slider = DoubleSlider(0.6, range=0..1 step 0.1)
number_slider_2 = DoubleSlider(0.5, range=0..1 step 0.1)
number_slider_3 = DoubleSlider(0.4, range=0..1 step 0.1)
color_palette = ColorPalette({R: 0, G: 95, B: 127, A: 255})
