# Dynamo graph Basic_UserNodes.dyn (Dynamo 3.0.3.7597)

# group: 控制球体位置
number_slider = DoubleSlider(10.4, range=0..20 step 0.1)
code_block = CodeBlock { 2; }
range = Range(end=number_slider, step=code_block)

byCoordinates = Point.ByCoordinates(x=range, y=range, lacing=CrossProduct)

# group: 控制球体半径
integer_slider = IntegerSlider(2, range=0..5 step 1)
getItemAtIndex = List.GetItemAtIndex(list=byCoordinates, index=integer_slider)
getItemAtIndex_2 = List.GetItemAtIndex(list=getItemAtIndex, index=integer_slider)
distanceTo = Geometry.DistanceTo(geometry=byCoordinates, other=getItemAtIndex_2)
code_block_2 = CodeBlock(x=distanceTo) { x / 10; }

bySphereCenterRadius = AnyCAD.UserNodes.Elements.UserShapeElementNode.BySphereCenterRadius(center=byCoordinates, radius=code_block_2)
