# Dynamo graph Hello_Rapid_Dynamo.dyn (Dynamo 3.0.3.7597)

code_block = CodeBlock { 1; 10; 1; }
range = Range(start=code_block.out0, end=code_block.out1, step=code_block.out2)
code_block_2 = CodeBlock(z=range) { GPntNode.ByCoordinates(0, 0, z); }
byCenterPointRadius = AnyCAD.CoreNodes.Geometry.GCircleNode.ByCenterPointRadius(center=code_block_2, radius=range)
byGCicle = AnyCAD.CoreNodes.Geometry.TopoShapeNode.ByGCicle(circle=byCenterPointRadius)
byTopoShape = AnyCAD.CoreNodes.Elements.ShapeElementNode.ByTopoShape(topo=byGCicle)
