# Dynamo graph test.dyn (Dynamo 3.0.3.7597)

byCoordinates = AnyCAD.CoreNodes.Geometry.GPntNode.ByCoordinates()
number_slider = DoubleSlider(1, range=0..100 step 0.1)
bySphereCenterRadius = AnyCAD.UserNodes.Elements.UserShapeNode.BySphereCenterRadius(center=byCoordinates, radius=number_slider)
